# Grasshopper definition Geometry_Workflow.ghx (Grasshopper 1.0.8)

# ---- group: 1 — SELECT PV PANEL
# START HERE: PLUG-IN SOLAR — GEOMETRY WORKFLOW
# Only 3 custom component types: Select PV Panel -> PV Geometry Generator -> PV Candidate Layout
# Open Start_Here.3dm first (millimeters), then this .gh file. All input geometry is internalized.
# Baseline: Heliene 320W; tilt 0; landscape False; gaps 0.10 m; offset 0.05 m; edge 0.10 m. Expected: 6 panels.
# 1 / PRODUCT: Choose a product with the built-in dropdown beneath Select PV Panel (or its right-click menu).
# Dims carries width, height and thickness together.
# Electrical specifications are reference metadata only; this package calculates no electricity.
select_pv = SelectPVPanel(SelectedProduct="Heliene 60M G1 All Black 320W")  # -> PanelDimensions, Width, Height, Thickness, ModuleSpecifications, RatedDCPower, ModuleEfficiency, PmaxTemperatureCoefficient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

# ---- group: 2 — PV GEOMETRY GENERATOR
pv_geometry = PVGeometryGenerator(Width=1.1, Height=1.7, Thickness=0.035, ReferencePlane=PlaneXY(0, 0, 0), PanelDimensions=select_pv.PanelDimensions)  # -> Panel, ActiveFace, Normal, ActiveArea, PanelFrame, PanelTemplate

# ---- group: 3 — PV CANDIDATE LAYOUT
mounting_face_internalized_mm = Brep(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)
building_mass_internalized_mm = Brep(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)
tilt_from_surface_degrees = Slider(0, range=0..60)
column_gap_m = Slider(0.1, range=0..1)
row_gap_m = Slider(0.1, range=0..1)
mounting_offset_m = Slider(0.05, range=0..0.5)
edge_setback_m = Slider(0.1, range=0..2)
landscape = BooleanToggle(False)
pv_candidate = PVCandidateLayout(
    PanelTemplate=pv_geometry.PanelTemplate,
    MountingSurface=mounting_face_internalized_mm,
    TiltFromSurface=tilt_from_surface_degrees,
    ColumnGap=column_gap_m,
    RowGap=row_gap_m,
    Landscape=landscape,
    MountingOffset=mounting_offset_m,
    EdgeSetback=edge_setback_m,
    BuildingAndObstacles=building_mass_internalized_mm,
    flip=False,
    rotation=0)  # -> CandidateLayout, CandidatePanels, AnalysisFaces, PanelCount, TotalAnalysisArea, PanelIDs, MountingDirection, TiltFromHorizontal, Report

# ----
panel_count = Panel(pv_candidate.PanelCount)
total_analysis_area_m2 = Panel(pv_candidate.TotalAnalysisArea)
panel_identifiers = Panel(pv_candidate.PanelIDs)
# 2 / GEOMETRY: Geometry Generator creates one panel template.
# Dims overrides manual dimensions. To test custom sizes, disconnect Dims and enter W/H/T.
# Template carries geometry and its front frame together. Distances entered in meters; output geometry uses Rhino document units.
# 3 / LAYOUT: Use sliders to change the layout.
# Right-click Candidate Layout for Flip and grid rotation.
# Candidate means geometric fit only: shading, electricity, optimization and installation engineering are outside this review.
# At tilt 0, Landscape=True should give 3 panels; reset False for 6.
layout_report = Panel(pv_candidate.Report)
