# Grasshopper definition Solar_Workflow.gh (Grasshopper 1.0.8)
# plug-ins: Plug-In Solar

# ---- group: 1 PRODUCT + GEOMETRY
# START HERE: PV SOLAR WORKFLOW v2
# Solar Conditions prepares weather and sky; Solar Exposure calculates; Exposure Map visualizes.
# Synthetic Atlanta clear-sky day, June 21, 14 hourly records. NOT annual weather or a yield forecast.
# Turn Run false before replacing inputs. Your existing definitions are not modified.
# USE YOUR EPW: LB Import EPW: location -> Location; direct_normal_rad -> DNR; diffuse_horizontal_rad -> DHR; global_horizontal_rad -> GHR.
# Ladybug collections supply HOYs automatically. Eddy3D partial numeric lists need its zero-based Hour of Year output.
# No sun-position wires required. Native hourly/non-leap data only. Right-click Conditions for source-index convention or detailed sky.
select_pv = SelectPVPanel(SelectedProduct="Heliene 60M G1 All Black 320W")  # -> PanelDimensions, Width, Height, Thickness, ModuleSpecifications, RatedDCPower, ModuleEfficiency, PmaxTemperatureCoefficient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
pv_geometry = PVGeometryGenerator(Width=1.1, Height=1.7, Thickness=0.035, ReferencePlane=PlaneXY(0, 0, 0), PanelDimensions=select_pv.PanelDimensions)  # -> Panel, ActiveFace, Normal, ActiveArea, PanelFrame, PanelTemplate

# ---- group: 2 CANDIDATE LAYOUT
selected_balcony_front = Brep(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)
building_balcony_slab = Brep([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])
tilt_from_surface_degrees = Slider(30, range=0..60)
pv_candidate = PVCandidateLayout(
    PanelTemplate=pv_geometry.PanelTemplate,
    MountingSurface=selected_balcony_front,
    TiltFromSurface=tilt_from_surface_degrees,
    ColumnGap=0.1,
    RowGap=0.1,
    Landscape=False,
    MountingOffset=0.05,
    EdgeSetback=0.1,
    BuildingAndObstacles=building_balcony_slab,
    flip=False,
    rotation=0)  # -> CandidateLayout, CandidatePanels, AnalysisFaces, PanelCount, TotalAnalysisArea, PanelIDs, MountingDirection, TiltFromHorizontal, Report

# ----
prepare_and_evaluate = BooleanToggle(True)

# ---- group: 3 SOLAR CONDITIONS
demo_location = Text("33.749,-84.388,-5,320")
demo_dnr = Data([232.8993805, 505.1417603, 649.3752884, 729.2975568, 774.8735461, 799.2212235, 808.1275566, 803.5086238, 784.3827615, 746.3880946, 679.3172773, 560.1266276, 336.1783817, 14.50986727])
demo_dhr = Data([43.9622685, 89.04551845, 117.0278746, 136.2070334, 149.3897724, 157.4490178, 160.6245054, 158.9607367, 152.4378767, 140.9044843, 123.7652698, 99.05986049, 60.71199585, 4.273987946])
demo_ghr = Data([88.520763, 285.4868927, 490.7541995, 674.5363901, 820.1331877, 916.0781128, 955.1932827, 934.6117998, 855.8374889, 724.7135853, 551.3463997, 350.5368646, 145.8631248, 5.110998921])
demo_hoys = Data([4110, 4111, 4112, 4113, 4114, 4115, 4116, 4117, 4118, 4119, 4120, 4121, 4122, 4123])
solar_conditions = PVSolarConditions(
    Location=demo_location,
    DirectNormalRadiation=demo_dnr,
    DiffuseHorizontalRadiation=demo_dhr,
    GlobalHorizontalRadiation=demo_ghr,
    WeatherHOYs=demo_hoys,
    North=0,
    GroundReflectance=0.2,
    Run=prepare_and_evaluate,
    detailed=False,
    irradianceUnits=False,
    oneBased=False)  # -> SolarConditions, SolarElevation, SolarAzimuth, Report

# ---- group: 4 SOLAR EXPOSURE
pv_exposure = PVSolarExposure(
    CandidateLayout=pv_candidate.CandidateLayout,
    SolarConditions=solar_conditions.SolarConditions,
    AnalysisGridSize=0.1,
    SensorOffset=0.001,
    Run=prepare_and_evaluate)  # -> SolarExposureResults, PanelIrradiance, PanelIrradiation, PanelIncidentSolarEnergy, TotalIncidentSolarEnergy, IrradiationReduction, PanelIDs, Report

# ---- group: 5 ELECTRICITY
demo_air_temperature_c = Data([27, 27, 27, 27, 27, 27, 27, 27, 27, 27, 27, 27, 27, 27])
demo_wind_m_s = Data([1.5, 1.5, 1.5, 1.5, 1.5, 1.5, 1.5, 1.5, 1.5, 1.5, 1.5, 1.5, 1.5, 1.5])
pv_electricity = PVElectricity(
    SolarExposure=pv_exposure.SolarExposureResults,
    ModuleSpecifications=select_pv.ModuleSpecifications,
    ArrayACRating=0,
    OtherDCLosses=0,
    FallbackAirTemperature=20,
    FallbackWindSpeed=1,
    ThermalU0=25,
    ThermalU1=6.84,
    AirTemperature=demo_air_temperature_c,
    WindSpeed=demo_wind_m_s)  # -> ElectricityResults, ACEnergy, DCEnergy, ArrayACPower, PanelDCPower, PanelDCEnergy, Months, MonthlyACEnergy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

# ---- group: 6 EXPOSURE MAP
exposure_map = PVExposureMap(SolarExposureResults=pv_exposure.SolarExposureResults)  # -> ExposureMap, Legend, CellIrradiation, AnalysisMesh, ChartValues, ChartLabels, SummaryData, Report

# ----
panel_irradiation_kwh_m2 = Panel(pv_exposure.PanelIrradiation)
ac_electricity_kwh = Panel(pv_electricity.ACEnergy)
# GRID MAP: Results -> PV Exposure Map. Each cell gets its own color.
# Exposure Grid controls both sampling and map resolution.
# Use fixed legend minimum/maximum for comparing alternatives.
# Report and CSV Summary are available; no HOY or time-step output sockets.
model_report = Panel(pv_exposure.Report)
